# Grasshopper definition 200909_carpet_ field_experiment.gh (Grasshopper 1.0.7)

python = GhPythonScript()  # -> out, a, b
# ---------- python: Python ----------
__author__ = "gregorjahner"

# Import points from a text file
import rhinoscriptsyntax as rs
import csv
import ghpythonlib.treehelpers as th
#import pandas as pd

def calTotalNumberOfSpots():
    #df = pd.read_csv("top_spots.csv", usecols = ['0'])
    #return df['0'].sum()
    pass


def CSVlist():
    #prompt the user for a file to import
    filter = "CSV file (*.csv)|*.csv|*.txt|All Files (*.*)|*.*||"
    filename = rs.OpenFileName("top_spots.csv", filter)
    if not filename: return

    tmplist = list()
    with open(filename) as csvfile:
    #with open('top_spots.csv') as csvfile:
        reader = csv.reader(csvfile)
        #reader = csv.reader(csvfile, delimiter=',')
        header_idx = True
        for row in reader:
            if header_idx == True:
                header_idx = False
                #print(row)
                continue

            lat = float(row[0])
            long = float(row[1])
            zero = float(row[3])
            print(lat, long, zero)

            rs.AddPoint(lat, long, zero)
            tmplist.append([lat, long, zero])
    print(tmplist)
    b = th.list_to_tree(tmplist)
    return b

"""
if( __name__ == "__main__" ):
    CSVlist()
    #calTotalNumberOfSpots()

"""
b = CSVlist()
# ---------- end python ----------
panel = Panel(python.b)
cull = CullPattern(List=panel, CullPattern=[True, False, False, False])  # -> flatten(List)
cull_2 = CullPattern(List=panel, CullPattern=[False, True, False, False])  # -> flatten(List)
cull_3 = CullPattern(List=panel, CullPattern=[False, False, True, False])  # -> flatten(List)
pt = ConstructPoint(XCoordinate=cull, YCoordinate=cull_2, ZCoordinate="0")

# ---- group: Oroginal Size scale 1000
number_slider = Slider(1000, range=0..1000)
midpoint_bdr = Point(<point referenced from the Rhino model>)
circle_bdr = Curve(<curve referenced from the Rhino model>)
boundary = BoundarySurfaces(Edges=circle_bdr)
scale = Scale(Geometry=pt, Center=midpoint_bdr, Factor=number_slider)  # -> Geometry, Transform

# ----
scale_2 = Scale(Geometry=boundary, Center=midpoint_bdr, Factor=number_slider)  # -> Geometry, Transform

# ---- group: scale 100
number_slider_2 = Slider(100, range=0..100)
scale_3 = Scale(Geometry=scale.Geometry, Center=midpoint_bdr, Factor=number_slider_2)  # -> Geometry, Transform
scale_4 = Scale(Geometry=scale_2.Geometry, Center=midpoint_bdr, Factor=number_slider_2)  # -> Geometry, Transform

# ----
panel_2 = Panel(pt)

# ---- group: Adding Z
division = Division(A=cull_3, B="5000")
pdecon = Deconstruct(Point=scale_3.Geometry)  # -> XComponent, YComponent, ZComponent
pt_2 = ConstructPoint(XCoordinate=pdecon.XComponent, YCoordinate=pdecon.YComponent, ZCoordinate=division)

# ---- group: Pipe view
movetoplane = MoveToPlane(Geometry=pt_2, Plane=PlaneXY(0, 0, 0), Above=True, Below=True)  # -> Geometry, Transform
ln = Line(StartPoint=pt_2, EndPoint=movetoplane.Geometry)
pipe = Pipe(Curve=ln, Radius=Slider(0.2, range=0..1), Caps="1")

# ---- group: Boundary (X,Y,0)
incurve = PointInCurve(Point=pt_2, Curve=scale_4.Geometry)  # -> Relationship, Point
bool = Boolean(incurve.Relationship)
dispatch = Dispatch(List=incurve.Point, DispatchPattern=bool)  # -> ListA, ListB
pt_3 = Point(flatten(dispatch.ListA))
panel_3 = Panel("12")
split = SplitList(List=pt_3, Index=panel_3)  # -> ListA, ListB
pt_4 = Point(flatten(split.ListA))
pt_5 = Point(split.ListB)

# ---- group: Boundary Z
dispatch_2 = Dispatch(List=division, DispatchPattern=bool)  # -> ListA, ListB
split_2 = SplitList(List=dispatch_2.ListA, Index=panel_3)  # -> ListA, ListB

# ----
fspin = SpinForce(Plane=pt_4, Strength=Slider(95, range=0..100), Radius=split_2.ListA, Decay=2)
mergef = MergeFields(Fields=fspin)
cp = ClosestPoint(Point=pt_4, Cloud=pt_5)  # -> ClosestPoint, CPIndex, Distance
multiplication = Multiplication(A=cp.Distance, B=Slider(300, range=0..300))
fline = FieldLine(Field=mergef, Point=pt_5, Steps=multiplication, Accuracy=0.1, Method=3)
